# Grasshopper definition build.gh (Grasshopper 1.0.7)
# plug-ins: Firefly.X

pt = ConstructPoint(XCoordinate="7036.267", YCoordinate="1219.89", ZCoordinate="539")

file = ReadFile(File="C:\Users\Ozguc Capunaman\Documents\GitHub\InteractiveDigitalFabrication\py\ghPython.py", PerLineParse=False)
geo = Geometry(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)
timer = Timer(TimerInterval=1, Target=[udp_listener, udp_sender])
udp_listener = UDPListener(Port="5005")
robotstudiopt = Point(Point(2000, 100, 750))
idf = GhPythonScript(Code=file, RUN=Toggle(True), RESET=Button(), Init_geo=geo, Udp_in=udp_listener, WObj=pt)  # -> Out, Udp_out
udp_sender = UDPSender(Data=idf.Udp_out, IPAddressOfUDPServer="127.0.0.1", UDPPort="5004")

# ---- group: Debu
rec = DataRecorder(idf.Out, DataLimit=-10, RecordData=True)
panel = Panel(rec)

# ----
timer_2 = Timer(TimerInterval=5000, Target=python)
python = GhPythonScript(WObj=pt, initGeo=geo)  # -> a, b; inputs WObj: Point3d
# ---------- python: Python ----------
__author__ = "Ozguc Capunaman"
__version__ = "2019.03.09"
                
import rhinoscriptsyntax as rs
import scriptcontext as sc
import math, os
                
                
def dist(pt0, pt1):
        return rs.Distance(pt0, pt1)
        
def clean(ptList):
    result = []
    for list in ptList:
        bin = []
        tmp = []
        tmplen = len(list)
#        print(tmplen)
        for i in range(len(list)):
            if i ==0:
                tmp.append(list[i])
            else:
                if dist(list[i-1], list[i]) > 1:
                    bin.append(tmp)
                    tmp = []
                tmp.append(list[i])
        bin.append(tmp)
        tmpResult = []
        for b in bin:
            if len(b) > len(tmpResult):
                tmpResult = b
        result.append(tmpResult)
#        print len(tmpResult)
#        print "-------"
    return result

def xyz2pts():
		filepath = str(DIR)+str(session)+"\\"+str(FNin)+".xyz"
#		print(filepath)
		if(os.path.exists(filepath)):
			result = []
			with open(filepath) as fp:  
			   line = fp.readline()
			   while line:
				   curLine = line.strip()
				   coord = curLine.split(' ')
				   for i in range(len(coord)):
					   coord[i] = float(coord[i])
				   result.append(rs.AddPoint(coord))
				   line = fp.readline()
			return result
		else:
			raise Exception('File doesn\'t exist!')
                
def shift(seq, n):
    for i in range(n):
        seq.append(seq.pop(0))
    return seq
                
def matchWObj(geoList, target):
    ref = rs.AddPoint(0,0,0)
    vec = rs.VectorCreate(target, ref)
    rot = rs.RotateObjects(geoList, rs.AddPoint(0,0,0), -90, copy=True)
    return rs.CopyObjects(rot, vec)
                
def dividePtCloud(points):
    ptList = []
    for i in range(len(points)):
        if i == 0:
            tmp = []
        elif i == len(points)-1:
            tmp.append(points[i])
            ptList.append(tmp)
        else:
            tmp.append(points[i])
            _,_,curZ = rs.PointCoordinates(points[i])
            _,_,nextZ = rs.PointCoordinates(points[i+1])
            distZ = curZ - nextZ
            if distZ < -10:
                ptList.append(tmp)
                tmp = []
    return ptList
                    
def divideLR(ptList):
    Llist = rs.CopyObjects(ptList[0:][::2])
    Rlist = rs.CopyObjects(ptList[1:][::2])
    shift(Rlist, 4)
    return Llist, Rlist
                    
def mergeLR(Llist, Rlist):
    print(len(Llist), len(Rlist))
    assert(len(Llist) == len(Rlist))
    mergedList = []
    for i in range(len(Llist)):
        if rs.CurveLength(Llist[i]) >= rs.CurveLength(Rlist[i]):
            mergedList.append(rs.CopyObject(Llist[i]))
        else:
            mergedList.append(rs.CopyObject(Rlist[i]))
    return mergedList
                
def createLines(ptList, rebuildCount = 10, degree = 3 ):
    crvList = []
    for i in range(len(ptList)):
         crv = rs.AddInterpCurve(ptList[i])
         rs.RebuildCurve(crv, degree,rebuildCount)
         crvList.append(crv)
    return crvList
                    
def offsetCurves(crvList, offsetFactor=5):
    result = []
    for i in range(len(crvList)):
        x,y,_ = rs.CurveEndPoint(crvList[i])
        vec = rs.VectorCreate((0,0,0),(x,y,0))
        unitVec = rs.VectorUnitize(vec)
        scaledVec = rs.VectorScale(unitVec, offsetFactor)
        tmp = rs.CopyObject(crvList[i], scaledVec)
        result.append(tmp)
    return result
                    
def reconSrf(crvList):
    return rs.AddLoftSrf(crvList, closed = True)
                
def getExtendedCrv(crvList, dist=50, layer_height=2.5, vecMul = .66):
    segmentCount = int(math.floor(dist / layer_height)) - 1
    tmpList = []
    for i in range(len(crvList)):
        extendedCrv = rs.ExtendCurveLength(crvList[i], 2, 0, dist)
        domStart, domEnd = rs.CurveDomain(extendedCrv)
        trimmedCrv = rs.TrimCurve(extendedCrv, (domStart, 0))
        tmpList.append(trimmedCrv)
    tmp = []
    ###Smooth Curves###
    for i in range(len(tmpList)):
        bottomPt = rs.CurveEndPoint(tmpList[i])
        zVec = rs.VectorAdd((0,0,0),(0,0,dist))
        topPt = rs.CopyObject(bottomPt, zVec)
        line = rs.AddLine(bottomPt, topPt)
        crvPts = rs.DivideCurve(tmpList[i], segmentCount)
        LinePts = rs.DivideCurve(line, segmentCount)
        for i in range(segmentCount):
            tmpVec = rs.VectorCreate(LinePts[segmentCount-i-1], crvPts[i])
            tmpVec = rs.VectorScale(tmpVec, vecMul)
            rs.MoveObject(crvPts[i], tmpVec)
        tmp.append(rs.AddInterpCurve(crvPts))
        result = []
        for crv in tmp:
            crvLen = rs.CurveLength(crv)
            if crvLen < dist:
                tmpExt = dist-crvLen
                result.append(rs.ExtendCurveLength(crv, 2, 0, tmpExt))
            else:
                result.append(rs.CopyObject(crv))
    return result
                    
def getExtendedTP(crvList, dist=50, layer_height=2.5):
    result = []
    ptsList = []
    lenList = []
    segmentCount = math.floor(dist / layer_height)
    for crv in crvList:
        tmp = rs.DivideCurve(crv, segmentCount)
        lenList.append(len(tmp))
        ptsList.append(tmp)
    for i in range(min(lenList)):
        tmp = []
        for j in range(len(ptsList)):
            tmp.append(ptsList[j][i])
        tmp.append(ptsList[0][i])
        tmpCrv = rs.AddInterpCurve(tmp, knotstyle=3)
        result.append(tmpCrv)
    result.reverse()
    return result
                    
def interpolateTP():
    ptCloud = xyz2pts()
    ptList = dividePtCloud(ptCloud)
    ptList = clean(ptList)
    crvL, crvR = divideLR(createLines(ptList, 5))
    crvMerged = mergeLR(crvL, crvR)#[0:][::2]
    offCrv = offsetCurves(crvMerged)
    srf = reconSrf(offCrv)
    extCrv = getExtendedCrv(offCrv, vecMul = param)
    for crv in extCrv:
        rs.RebuildCurve(crv, 3, 20)
    srf2 = reconSrf(extCrv)
#    WObjCrv = matchWObj(extCrv, WObj)
#    extTP = getExtendedTP(extCrv)
    return srf, srf2
                
        
#if (sc.sticky.has_key("DIR") and sc.sticky.has_key("FN") and sc.sticky.has_key("param") and sc.sticky.has_key("session")):
DIR = sc.sticky["DIR"]
FNin = sc.sticky["FN"]
param = sc.sticky["param"]
session = sc.sticky["session"]
a, b = interpolateTP()
#else:
#    a = initGeo
#    b = None
# ---------- end python ----------

timer_3 = Timer(TimerInterval=1, Target=rotatingtable)
rotatingtable = GhPythonScript()  # -> angle
# ---------- rotatingtable: Python ----------
__author__ = "Ozguc Capunaman"
__version__ = "2019.04.15"

import rhinoscriptsyntax as rs
import scriptcontext as sc

key = "angle"
if sc.sticky.has_key(key):
    angle = sc.sticky[key]
else:
	sc.sticky[key] = 0
	angle = sc.sticky[key]

angle += 1
angle = angle%360
sc.sticky[key] = angle
# ---------- end rotatingtable ----------
panel_2 = Panel(rotatingtable)
rotate = Rotate(Geometry=flatten(python.a), Angle=degrees(rotatingtable), Plane=PlaneXY(0, 0, 0))  # -> Geometry, Transform
number_slider = Slider(0.1, range=0..1)
item = ListItem(List=rotate.Geometry, Index=0, Wrap=False)  # -> Item, Item1
number_slider_2 = Slider(25, range=0..100)
material = CreateMaterial(
    Diffuse=ColourSwatch(SwatchColor=RGB(181, 181, 181)),
    Specular=RGB(255, 255, 255),
    Emission=RGB(0, 0, 0),
    Transparency=number_slider,
    Shine=number_slider_2)
material_2 = CreateMaterial(
    Diffuse=ColourSwatch(SwatchColor=RGB(104, 206, 40)),
    Specular=RGB(255, 255, 255),
    Emission=RGB(0, 0, 0),
    Transparency=number_slider,
    Shine=number_slider_2)
preview = CustomPreview(Geometry=item.Item, Material=material)

rotate_2 = Rotate(Geometry=flatten(python.b), Angle=degrees(rotatingtable), Plane=PlaneXY(0, 0, 0))  # -> Geometry, Transform

preview_2 = CustomPreview(Geometry=rotate_2.Geometry, Material=material_2)
