# Grasshopper definition client.gh (Grasshopper 1.0.7)

python = GhPythonScript()  # -> out, a
# ---------- python: Python ----------
__author__ = "Ozguc Capunaman"
__version__ = "2019.03.11"

import rhinoscriptsyntax as rs
import socket


TCP_IP = '127.0.0.1'
TCP_PORT = 5005
BUFFER_SIZE = 1024
MESSAGE = "Hello, World!"

s = socket.socket(socket.AF_INET, socket.SOCK_STREAM)
s.connect((TCP_IP, TCP_PORT))
s.send(MESSAGE)
data = s.recv(BUFFER_SIZE)
s.close()

print "received data:", data
# ---------- end python ----------
