# Grasshopper definition ghApp.gh (Grasshopper 1.0.7)

path = FilePath("C:\Users\Ozguc Capunaman\Documents\GitHub\InteractiveDigitalFabrication\xyz\")
python = GhPythonScript(FileDir=path, FileName="cup")  # -> pts, crv, srf
# ---------- python: Python ----------
__author__ = "Ozguc Capunaman"
__version__ = "2019.03.11"

import rhinoscriptsyntax as rs
import os.path

def xyz2pt(DIR = "C:\Users\Ozguc Capunaman\Documents\GitHub\InteractiveDigitalFabrication\xyz\\", FN = "cup"):
    filepath = DIR+FN+".xyz"
    if(os.path.exists(filepath)):
        result = []
        with open(filepath) as fp:  
           line = fp.readline()
           cnt = 1
           while line:
               curLine = line.strip()
               coord = curLine.split(' ')
               for i in range(len(coord)):
                   coord[i] = float(coord[i])
               result.append(rs.AddPoint(coord))
               line = fp.readline()
               cnt += 1
    return result
    
def dividePtCloud(points):
    ptList = []
    for i in range(len(points)):
        if i == 0:
            tmp = []
        elif i == len(points)-1:
            tmp.append(points[i])
            ptList.append(tmp)
        else:
            tmp.append(points[i])
            _,_,curZ = rs.PointCoordinates(points[i])
            _,_,nextZ = rs.PointCoordinates(points[i+1])
            distZ = curZ - nextZ
            if distZ < 0:
                ptList.append(tmp)
                tmp = []
    return ptList

def createLines(ptList, degree = 3, rebuildCount = 10):
    crvList = []
    for i in range(len(ptList)):
         crv = rs.AddCurve(ptList[i])
         rs.RebuildCurve(crv, degree,rebuildCount)
         crvList.append(crv)
    return crvList
    
def reconSrf(crvList):
    return rs.AddLoftSrf(crvList, closed = True)
    
pts = xyz2pt(FileDir, FileName)
crv = createLines(dividePtCloud(pts))
srf = reconSrf(crv)
# ---------- end python ----------
