# Grasshopper definition processPointCloud.gh (Grasshopper 1.0.7)
# plug-ins: Volvox

run = Button()
dir = FilePath("C:\Users\Ozguc Capunaman\Documents\GitHub\InteractiveDigitalFabrication\ply\print_5mm_bent_overlap2.xyz")
xyzloadex = LoadXyzEx(FilePath=dir, Mask="x y z", Percent=100, Run=run, Abort=False)
decloud = DeconstructCloud(Cloud=xyzloadex)  # -> Points, Normals, Colors
python = GhPythonScript(pts=decloud.Points)  # -> srf, crv; inputs pts: list; disabled
# ---------- python: Python ----------
__author__ = "Ozguc Capunaman"
__version__ = "2019.03.09"

import rhinoscriptsyntax as rs


def dividePtCloud(points):
    ptList = []
    for i in range(len(points)):
        if i == 0:
            tmp = []
        elif i == len(points)-1:
            tmp.append(points[i])
            ptList.append(tmp)
        else:
            tmp.append(points[i])
            _,_,curZ = rs.PointCoordinates(points[i])
            _,_,nextZ = rs.PointCoordinates(points[i+1])
            distZ = curZ - nextZ
            if distZ < 0:
                ptList.append(tmp)
                tmp = []
    return ptList
    
def divideLR(ptList):
    Llist = ptList[0:][::2]
    Rlist = ptList[1:][::2]
    return Llist, Rlist

def createLines(ptList, degree = 3, rebuildCount = 5):
    crvList = []
    for i in range(len(ptList)):
         crv = rs.AddCurve(ptList[i])
         rs.RebuildCurve(crv, degree,rebuildCount)
         crvList.append(crv)
    return crvList
    
def reconSrf(crvList):
    return rs.AddLoftSrf(crvList, closed = True)

ptList = dividePtCloud(pts)
Llist, Rlist = divideLR(ptList)
crv = createLines(Llist)
#srf = reconSrf(crv)
# ---------- end python ----------
python_2 = GhPythonScript(pts=decloud.Points, x=Slider(10, range=0..10))  # -> srf, srf2, crvL, crvR, crvMerged; inputs pts: list, x: Int32
# ---------- python_2: Python ----------
__author__ = "Ozguc Capunaman"
__version__ = "2019.03.09"

import rhinoscriptsyntax as rs

def shift(seq, n):
    for i in range(n):
        seq.append(seq.pop(0))
    return seq

def dividePtCloud(points):
    ptList = []
    for i in range(len(points)):
        if i == 0:
            tmp = []
        elif i == len(points)-1:
            tmp.append(points[i])
            ptList.append(tmp)
        else:
            tmp.append(points[i])
            _,_,curZ = rs.PointCoordinates(points[i])
            _,_,nextZ = rs.PointCoordinates(points[i+1])
            distZ = curZ - nextZ
            if distZ < -50:
                ptList.append(tmp)
                tmp = []
    return ptList
    
def divideLR(ptList):
    Llist = ptList[0:][::2]
#    Llist = Llist[:-1]
    Rlist = ptList[1:][::2]
#    Rlist = Rlist[:-1]
    shift(Rlist, 4)
    return Llist, Rlist
    
def mergeLR(Llist, Rlist):
    assert(len(Llist) == len(Rlist))
    mergedList = []
    for i in range(len(Llist)):
        if rs.CurveLength(Llist[i]) >= rs.CurveLength(Rlist[i]):
            mergedList.append(Llist[i])
        else:
            mergedList.append(Rlist[i])
    return mergedList

def createLines(ptList, rebuildCount = 10, degree = 3 ):
    crvList = []
    for i in range(len(ptList)):
         crv = rs.AddCurve(ptList[i])
         rs.RebuildCurve(crv, degree,rebuildCount)
         crvList.append(crv)
    return crvList
    
def reconSrf(crvList):
    return rs.AddLoftSrf(crvList, closed = True)

ptList = dividePtCloud(pts)
crvL, crvR = divideLR(createLines(ptList, x))
crvMerged = mergeLR(crvL, crvR)
srf = reconSrf(crvMerged)
# ---------- end python_2 ----------
python_3 = GhPythonScript()  # -> out, a; inputs crvList: list; disabled
# ---------- python_3: Python ----------
__author__ = "Ozguc Capunaman"
__version__ = "2019.03.16"

import rhinoscriptsyntax as rs

def getExtendedCurves(crvList):
    result = []
    for i in range(len(crvList)):
        extendedCrv = rs.ExtendCurveLength(crvList[i], 2, 0, 50)
        domStart, domEnd = rs.CurveDomain(extendedCrv)
        trimmedCrv = rs.TrimCurve(extendedCrv, (domStart, 0))
        result.append(trimmedCrv)
    return result
def getExtendedToolPath(crvList, layer_height):
    result = []
    ptsList = []
    lenList = []
    for crv in crvList:
        tmp = rs.DivideCurveEquidistant(crv, layer_height)
        lenList.append(len(tmp))
        ptsList.append(tmp)
    print(lenList)
    for i in range(min(lenList)):
        tmp = []
        for j in range(len(ptsList)):
            tmp.append(ptsList[j][i])
        tmp.append(ptsList[0][i])
        result.append(rs.AddCurve(tmp))
    return result
    
#def getExtended Toolpath(crvLst, layer_height):
#    

a = getExtendedCurves(crvList)
a = getExtendedToolPath(a, 1)
# ---------- end python_3 ----------
srf = Surface(python_2.srf)
crv = Curve(python_2.crvL)
item = ListItem(List=python_2.crvL, Index=0, Wrap=True)
item_2 = ListItem(List=python_2.crvR, Index=0, Wrap=True)
material = CreateMaterial(
    Diffuse=ColourSwatch(SwatchColor=RGB(181, 181, 181)),
    Specular=RGB(255, 255, 255),
    Emission=RGB(0, 0, 0),
    Transparency=0,
    Shine=0)
preview = CustomPreview(Geometry=srf, Material=material)
