# Grasshopper definition processPointCloud2.gh (Grasshopper 1.0.7)
# plug-ins: Volvox

run = Button()
dir = FilePath("C:\Users\Ozguc Capunaman\Documents\GitHub\InteractiveDigitalFabrication\ply\print_5mm_bent_overlap2.xyz")
number_slider = Slider(5, range=0..10)
xyzloadex = LoadXyzEx(FilePath=dir, Mask="x y z", Percent=100, Run=run, Abort=False)
pt = Point(Point(7061.829624, 1222.70303, 520.6799383))
decloud = DeconstructCloud(Cloud=xyzloadex)  # -> Points, Normals, Colors
python = GhPythonScript(pts=decloud.Points, WObj=pt)  # -> a, b; inputs pts: list, WObj: Point3d
# ---------- python: Python ----------
__author__ = "Ozguc Capunaman"
__version__ = "2019.03.09"

import rhinoscriptsyntax as rs
import math

def shift(seq, n):
    for i in range(n):
        seq.append(seq.pop(0))
    return seq

def matchWObj(geoList, target):
    ref = rs.AddPoint(0,0,0)
    vec = rs.VectorCreate(target, ref)
    rot = rs.RotateObjects(geoList, rs.AddPoint(0,0,0), -90, copy=True)
    return rs.CopyObjects(rot, vec)

def dividePtCloud(points):
    ptList = []
    for i in range(len(points)):
        if i == 0:
            tmp = []
        elif i == len(points)-1:
            tmp.append(points[i])
            ptList.append(tmp)
        else:
            tmp.append(points[i])
            _,_,curZ = rs.PointCoordinates(points[i])
            _,_,nextZ = rs.PointCoordinates(points[i+1])
            distZ = curZ - nextZ
            if distZ < -50:
                ptList.append(tmp)
                tmp = []
    return ptList
    
def divideLR(ptList):
    Llist = rs.CopyObjects(ptList[0:][::2])
    Rlist = rs.CopyObjects(ptList[1:][::2])
    shift(Rlist, 4)
    return Llist, Rlist
    
def mergeLR(Llist, Rlist):
    assert(len(Llist) == len(Rlist))
    mergedList = []
    for i in range(len(Llist)):
        if rs.CurveLength(Llist[i]) >= rs.CurveLength(Rlist[i]):
            mergedList.append(rs.CopyObject(Llist[i]))
        else:
            mergedList.append(rs.CopyObject(Rlist[i]))
    return mergedList

def createLines(ptList, rebuildCount = 10, degree = 3 ):
    crvList = []
    for i in range(len(ptList)):
         crv = rs.AddInterpCurve(ptList[i])
         rs.RebuildCurve(crv, degree,rebuildCount)
         crvList.append(crv)
    return crvList
    
def offsetCurves(crvList, offsetFactor=5):
    result = []
    for i in range(len(crvList)):
        x,y,_ = rs.CurveEndPoint(crvList[i])
        vec = rs.VectorCreate((0,0,0),(x,y,0))
        unitVec = rs.VectorUnitize(vec)
        scaledVec = rs.VectorScale(unitVec, offsetFactor)
        tmp = rs.CopyObject(crvList[i], scaledVec)
        result.append(tmp)
    return result
    
def reconSrf(crvList):
    return rs.AddLoftSrf(crvList, closed = True)

def getExtendedCrv(crvList, dist=50, layer_height=2.5, vecMul = .66):
    segmentCount = int(math.floor(dist / layer_height)) - 1
    tmpList = []
    for i in range(len(crvList)):
        extendedCrv = rs.ExtendCurveLength(crvList[i], 2, 0, dist)
        domStart, domEnd = rs.CurveDomain(extendedCrv)
        trimmedCrv = rs.TrimCurve(extendedCrv, (domStart, 0))
        tmpList.append(trimmedCrv)
    tmp = []
    ###Smooth Curves###
    for i in range(len(tmpList)):
        bottomPt = rs.CurveEndPoint(tmpList[i])
        zVec = rs.VectorAdd((0,0,0),(0,0,dist))
        topPt = rs.CopyObject(bottomPt, zVec)
        line = rs.AddLine(bottomPt, topPt)
        crvPts = rs.DivideCurve(tmpList[i], segmentCount)
        LinePts = rs.DivideCurve(line, segmentCount)
        for i in range(segmentCount):
            tmpVec = rs.VectorCreate(LinePts[segmentCount-i-1], crvPts[i])
            tmpVec = rs.VectorScale(tmpVec, vecMul)
            rs.MoveObject(crvPts[i], tmpVec)
        tmp.append(rs.AddInterpCurve(crvPts))
        result = []
        for crv in tmp:
            crvLen = rs.CurveLength(crv)
            if crvLen < dist:
                tmpExt = dist-crvLen
                result.append(rs.ExtendCurveLength(crv, 2, 0, tmpExt))
            else:
                result.append(rs.CopyObject(crv))
    return result
    
def getExtendedTP(crvList, dist=50, layer_height=2.5):
    result = []
    ptsList = []
    lenList = []
    segmentCount = math.floor(dist / layer_height)
    for crv in crvList:
        tmp = rs.DivideCurve(crv, segmentCount)
        lenList.append(len(tmp))
        ptsList.append(tmp)
    for i in range(min(lenList)):
        tmp = []
        for j in range(len(ptsList)):
            tmp.append(ptsList[j][i])
        tmp.append(ptsList[0][i])
        tmpCrv = rs.AddInterpCurve(tmp, knotstyle=3)
        result.append(tmpCrv)
    result.reverse()
    return result
    
def interpolateTP(ptCloud):
    ptList = dividePtCloud(ptCloud)
    crvL, crvR = divideLR(createLines(ptList, 5))
    crvMerged = mergeLR(crvL, crvR)
    offCrv = offsetCurves(crvMerged)
    WObjCrv = matchWObj(offCrv, WObj)
    srf = reconSrf(WObjCrv)
    extCrv = getExtendedCrv(WObjCrv)
    extTP = getExtendedTP(extCrv)
    return srf, extTP

a, b = interpolateTP(pts)
# ---------- end python ----------
number_slider_2 = Slider(5, range=0..10)
python_2 = GhPythonScript(pts=decloud.Points)  # -> srf, crv; inputs pts: list; disabled
# ---------- python_2: Python ----------
__author__ = "Ozguc Capunaman"
__version__ = "2019.03.09"

import rhinoscriptsyntax as rs


def dividePtCloud(points):
    ptList = []
    for i in range(len(points)):
        if i == 0:
            tmp = []
        elif i == len(points)-1:
            tmp.append(points[i])
            ptList.append(tmp)
        else:
            tmp.append(points[i])
            _,_,curZ = rs.PointCoordinates(points[i])
            _,_,nextZ = rs.PointCoordinates(points[i+1])
            distZ = curZ - nextZ
            if distZ < 0:
                ptList.append(tmp)
                tmp = []
    return ptList
    
def divideLR(ptList):
    Llist = ptList[0:][::2]
    Rlist = ptList[1:][::2]
    return Llist, Rlist

def createLines(ptList, degree = 3, rebuildCount = 5):
    crvList = []
    for i in range(len(ptList)):
         crv = rs.AddCurve(ptList[i])
         rs.RebuildCurve(crv, degree,rebuildCount)
         crvList.append(crv)
    return crvList
    
def reconSrf(crvList):
    return rs.AddLoftSrf(crvList, closed = True)

ptList = dividePtCloud(pts)
Llist, Rlist = divideLR(ptList)
crv = createLines(Llist)
#srf = reconSrf(crv)
# ---------- end python_2 ----------
crv = Curve(python.b)
len = Length()
material = CreateMaterial(
    Diffuse=ColourSwatch(SwatchColor=RGB(181, 181, 181)),
    Specular=RGB(255, 255, 255),
    Emission=RGB(0, 0, 0),
    Transparency=0,
    Shine=0)
preview = CustomPreview(Geometry=python.a, Material=material)
