# Grasshopper definition xyz2pt.gh (Grasshopper 1.0.7)

path = FilePath("C:\Users\Ozguc Capunaman\Documents\GitHub\InteractiveDigitalFabrication\xyz\")
tcp_server = GhPythonScript()  # -> Out, A
python = GhPythonScript(DIR=path, FN="cup")  # -> out, a
# ---------- python: Python ----------
__author__ = "Ozguc Capunaman"
__version__ = "2019.03.11"

import rhinoscriptsyntax as rs
import os.path

def xyz2pt(DIR = "C:\Users\Ozguc Capunaman\Documents\GitHub\InteractiveDigitalFabrication\xyz\\", FN = "cup"):
    filepath = DIR+FN+".xyz"
    if(os.path.exists(filepath)):
        result = []
        with open(filepath) as fp:  
           line = fp.readline()
           cnt = 1
           while line:
               curLine = line.strip()
               coord = curLine.split(' ')
               for i in range(len(coord)):
                   coord[i] = float(coord[i])
               result.append(coord)
               line = fp.readline()
               cnt += 1
    
xyz2pt(DIR, FN)
# ---------- end python ----------
